# Dynamo graph ClearAllFamilesTypes_script.dyn (Dynamo 2.12.0.5650)
# packages: Orchid 212.1.0.8138, Rhythm 2022.4.1

code_block = CodeBlock()
# ---------- code_block.designscript (3 lines) ----------
"Test";
"All types Erased !
Defaut type is FERMI MODEL";
# ----------------------------------------
o_document_current = Orchid.RevitProject.Common.Document.Current()
code_block_2 = CodeBlock { "__ FERMI Model __"; }
o_familytype_all = Orchid.RevitFamily.FamilyType.All()
o_familytype_name = Orchid.RevitFamily.FamilyType.Name(familyType=o_familytype_all@L1)
o_familytype_current = Orchid.RevitFamily.FamilyType.Current()
o_familytype_name_2 = Orchid.RevitFamily.FamilyType.Name(familyType=o_familytype_current)
eq = o_familytype_name@L1 == o_familytype_name_2
filterByBoolMask = List.FilterByBoolMask(list=o_familytype_all, mask=eq)
o_familytype_name_3 = Orchid.RevitFamily.FamilyType.Name(familyType=filterByBoolMask.in@L1)
ne = code_block_2 != o_familytype_name_3
o_familytype_delete = Orchid.RevitFamily.FamilyType.Delete(familyDocument=o_document_current, familyType=filterByBoolMask.out)
o_datastream_await = Orchid.Common.DataStream.Await(pass=o_familytype_name_3, waitFor=o_familytype_delete)
code_block_3 = CodeBlock { ""; }
if_ = RefactoredIf(test=ne@L1, true=o_datastream_await@L1, false=code_block_3)
o_familytype_rename = Orchid.RevitFamily.FamilyType.Rename(familyDocument=o_document_current, sourceName=if_, targetName=code_block_2)
ʳʰʸᵗʰᵐ_helpers_usermessage = Rhythm.Revit.Helpers.Helpers.UserMessage(caption=code_block.out0, message=code_block.out1, obj=o_familytype_rename@L1)
code_block_4 = CodeBlock {  }
